# Grasshopper definition GH_Challenges_A_Intro_to_Grasshopper.ghx (Grasshopper 0.9.76)

# 挑战A10: 删除中间的滑条，重新连接组件，使得创建的圆的直径是递增的。
number_slider = Slider(10, range=0..10)
# 挑战A4: 仅仅改变滑条(slider)，让乘法显示板中的数值变为9000.
number_slider_2 = Slider(10, range=0..10)
# Grasshopper挑战
# By Dan Taeyoung, 2016. https://github.com/provolot/GrasshopperChallenges
# 马逸东 翻译，2016 https://github.com/maajor/GrasshopperChallenges
# 挑战 A - Grasshopper入门
# 挑战A0: 把滑条(slider)连接到显示板(panel)上
# 挑战A1: 改变滑条(slider)，把数值设置成7 (或者 7.0).
number_slider_3 = Slider(0, range=0..10)
# 挑战A8: 删除一个滑条(slider)，重新连接所有组件。使得可以用一个滑条可以同时控制圆柱的高度和直径。
construct_point = ConstructPoint(XCoordinate=150, YCoordinate=0, ZCoordinate=0)
# 挑战A7: 创建一个圆柱体。仅仅添加一个挤出(Extrude)组件，使用Z方向(UnitZ)向量沿Z方向挤出这个圆。
construct_point_2 = ConstructPoint(XCoordinate=100, YCoordinate=0, ZCoordinate=0)
# 挑战A2: 把数值精确地设置成3.14.
number_slider_4 = Slider(0, range=0..10)
# 挑战A3: 仅仅改变滑条(slider)，把显示板(panel)的数值设置到50
number_slider_5 = Slider(10, range=0..10)
# 挑战A5: 给画圆(Circle)组件添加一个滑条(slider)输入，创造一个面积大于300平方单位的圆。
construct_point_3 = ConstructPoint(XCoordinate=0, YCoordinate=0, ZCoordinate=0)
# 挑战A6: 把圆(Circle)组件移除，使用多边形(Polygon)组件代替，创建一个9边的多边形。
construct_point_4 = ConstructPoint(XCoordinate=50, YCoordinate=0, ZCoordinate=0)
# 挑战A9: 给序列(Series)组件添加滑条来创建20个奇数，比如1,3,5.....
number_slider_6 = Slider(20, range=0..20)
series = Series(Start=0, Step=1, Count=10)

# ---- group: 删除我！
number_slider_7 = Slider(40, range=0..100)

# ----
# 挑战A11: 创建10个圆柱体，它们在直径和高度上都是递增的。
series_2 = Series(Start=1, Step=22, Count=10)
series_3 = Series(Start=1, Step=22, Count=number_slider)
addition = Addition(A=number_slider_5, B="10")
subtraction = Subtraction(A=number_slider_2, B="-10")
division = Division(A=number_slider_2, B="-10")
multiplication = Multiplication(A=number_slider_2, B="-10")
circle = Circle(Plane=construct_point_3, Radius=1)
construct_point_5 = ConstructPoint(XCoordinate=200, YCoordinate=series_2, ZCoordinate=0)
unit_z = UnitZ(Factor=number_slider_6)
circle_2 = Circle(Plane=construct_point, Radius=Slider(7.55, range=0..10))
unit_z_2 = UnitZ(Factor=Slider(20, range=0..20))
circle_3 = Circle(Plane=construct_point_2, Radius=Slider(5, range=0..10))
construct_point_6 = ConstructPoint(XCoordinate=150, YCoordinate=series_3, ZCoordinate=0)

# ---- group: 这是一个显示板(panel)，它帮你可视化数据与几何体
panel = Panel()

# ----
panel_2 = Panel(number_slider_4)
panel_3 = Panel(Slider(0, range=0..10))
panel_4 = Panel(addition)
panel_5 = Panel(division)
乘法显示板 = Panel(multiplication)
panel_6 = Panel(subtraction)
division_2 = Division(A=number_slider_7, B=Slider(4, range=0..10))
polygon = Polygon(Plane=PlaneXY(0, 0, 0), Radius=3, Segments=6, FilletRadius=0)  # -> Polygon, Length
panel_7 = Panel(series)
circle_4 = Circle(Plane=construct_point_4, Radius=Slider(5, range=0..10))

# ---- group: 注意这个面积(Area)组件同时还会返回中心点的数据
area = Area(Geometry=circle)  # -> Area, Centroid

# ----
extrude = Extrude(Base=circle_2, Direction=unit_z)
checker = Checker_2(data=panel_2)
checker_2 = Checker_11(data=panel)
checker_3 = Checker_3(data=panel_4)
checker_4 = Checker_7(data=series)
checker_5 = Checker(data=panel_3)
checker_6 = Checker_4(data=乘法显示板)
checker_7 = Checker_5(data=circle_4)
# 小提示:
# 在"Number Slider"文字上双击这个滑条(slider)来编辑滑条属性
panel_8 = Panel(checker)
panel_9 = Panel(checker_2)

# ---- group: 注意到这个组件给圆柱加上了空缺面(Cap)
cap_holes = CapHoles(Brep=extrude)

# ----
panel_10 = Panel(area.Area)
panel_11 = Panel(checker_3)
panel_12 = Panel(checker_5)
panel_13 = Panel(checker_4)
panel_14 = Panel(checker_6)
geometry = Geometry()
cone = Cone(Base=PlaneXY(0, 0, 0), Radius=0.5, Length=1)  # -> Cone, Tip
circle_5 = Circle(Plane=construct_point_6, Radius=division_2)
panel_15 = Panel(checker_7)
checker_8 = Checker_8(data=geometry)
checker_9 = Checker_6(data=area.Area)
geometry_2 = Geometry(circle_5)
# 提示：
# 在菜单中寻找挤出(Extrude)组件。也可以双击Grasshopper画布，弹出一个搜索框，键入"Extrude"，选择平常的挤出，不要选沿...挤出(Extrude Along)或者其他。
panel_16 = Panel(checker_8)
geometry_3 = Geometry(cone.Cone)
panel_17 = Panel(checker_9)
checker_10 = Checker_9(data=geometry_2)
checker_11 = Checker_10(data=geometry_3)
panel_18 = Panel(checker_10)
# The 'List' in 'Sift Pattern' can take any kind of list, not just lists of numbers.
panel_19 = Panel(checker_11)

# ==== cluster Checker
data = ClusterInput()
data_2 = Data(data)
equality = Equality(FirstNumber="7", SecondNumber=data_2)  # -> Equality, Inequality
stream_filter = StreamFilter(Gate=equality.Equality, Stream0=" ", Stream1="Correct!")
data_3 = Data(stream_filter)
data_4 = ClusterOutput(data_3)

# ==== cluster Checker_2
data = ClusterInput()
data_2 = Data(data)
equality = Equality(FirstNumber="3.14", SecondNumber=data_2)  # -> Equality, Inequality
stream_filter = StreamFilter(Gate=equality.Equality, Stream0=" ", Stream1="Correct!")
data_3 = Data(stream_filter)
data_4 = ClusterOutput(data_3)

# ==== cluster Checker_3
data = ClusterInput()
data_2 = Data(data)
equality = Equality(FirstNumber="50", SecondNumber=data_2)  # -> Equality, Inequality
stream_filter = StreamFilter(Gate=equality.Equality, Stream0=" ", Stream1="Correct!")
data_3 = Data(stream_filter)
data_4 = ClusterOutput(data_3)

# ==== cluster Checker_4
data = ClusterInput()
data_2 = Data(data)
equality = Equality(FirstNumber="9000", SecondNumber=data_2)  # -> Equality, Inequality
stream_filter = StreamFilter(Gate=equality.Equality, Stream0=" ", Stream1="Correct!")
data_3 = Data(stream_filter)
data_4 = ClusterOutput(data_3)

# ==== cluster Checker_5
data = ClusterInput()
data_2 = Data(data)
explode = Explode(Curve=data_2, Recursive=True)  # -> Segments, Vertices
list_length = ListLength(List=explode.Segments)
equality = Equality(FirstNumber="9", SecondNumber=list_length)  # -> Equality, Inequality
stream_filter = StreamFilter(Gate=equality.Equality, Stream0=" ", Stream1="Correct!")
null_item = NullItem(Item=equality.Equality)  # -> NullFlags, InvalidFlags, Description
stream_filter_2 = StreamFilter(Gate=null_item.NullFlags, Stream0=stream_filter, Stream1=" ")
data_3 = Data(stream_filter_2)
data_4 = ClusterOutput(data_3)

# ==== cluster Checker_6
data = ClusterInput()
data_2 = Data(data)
larger_than = LargerThan(FirstNumber=data_2, SecondNumber="300")  # -> LargerThan, OrEqualTo
stream_filter = StreamFilter(Gate=larger_than.LargerThan, Stream0=" ", Stream1="Correct!")
data_3 = Data(stream_filter)
data_4 = ClusterOutput(data_3)

# ==== cluster Checker_7
data = ClusterInput()
data_2 = Data(data)
mass_addition = MassAddition(Input=data_2)  # -> Result, PartialResults
equality = Equality(FirstNumber="400", SecondNumber=mass_addition.Result)  # -> Equality, Inequality
stream_filter = StreamFilter(Gate=equality.Equality, Stream0=" ", Stream1="Correct!")
null_item = NullItem(Item=equality.Equality)  # -> NullFlags, InvalidFlags, Description
stream_filter_2 = StreamFilter(Gate=null_item.NullFlags, Stream0=stream_filter, Stream1=" ")
data_3 = Data(stream_filter_2)
data_4 = ClusterOutput(data_3)

# ==== cluster Checker_8
data = ClusterInput()
data_2 = Data(data)
brep_topology = BrepTopology(Brep=data_2, PerspectiveOnly=False)  # -> FaceFaceAdjacency, FaceEdgeAdjacency, EdgeFaceAdjacency
data_recorder = DataRecorder(data_2, DataLimit=10, RecordData=True)
list_length = ListLength(List=brep_topology.FaceEdgeAdjacency)
panel = Panel(data_recorder)
equality = Equality(FirstNumber="3", SecondNumber=list_length)  # -> Equality, Inequality
panel_2 = Panel(brep_topology.FaceEdgeAdjacency)
stream_filter = StreamFilter(Gate=equality.Equality, Stream0=" ", Stream1="Correct!")
null_item = NullItem(Item=equality.Equality)  # -> NullFlags, InvalidFlags, Description
stream_filter_2 = StreamFilter(Gate=null_item.NullFlags, Stream0=stream_filter, Stream1=" ")
data_3 = Data(stream_filter_2)
data_4 = ClusterOutput(data_3)

# ==== cluster Checker_9
data = ClusterInput()
data_2 = Data(data)
area = Area(Geometry=data_2)  # -> Area, Centroid
panel = Panel("10")
list_item = ListItem(List=area.Area, Index=0, Wrap=True)  # -> Item1, Item
larger_than = LargerThan(FirstNumber=list_item.Item1, SecondNumber=list_item.Item)  # -> LargerThan, OrEqualTo
stream_filter = StreamFilter(Gate=larger_than.LargerThan, Stream0=" ", Stream1="Correct!")
null_item = NullItem(Item=larger_than.LargerThan)  # -> NullFlags, InvalidFlags, Description
stream_filter_2 = StreamFilter(Gate=null_item.NullFlags, Stream0=stream_filter, Stream1=" ")
data_3 = Data(stream_filter_2)
data_4 = ClusterOutput(data_3)

# ==== cluster Checker_10
data = ClusterInput()
data_2 = Data(data)
volume = Volume(Geometry=data_2)  # -> Volume, Centroid
panel = Panel("10")
list_item = ListItem(List=volume.Volume, Index=0, Wrap=True)  # -> Item1, Item
larger_than = LargerThan(FirstNumber=list_item.Item1, SecondNumber=list_item.Item)  # -> LargerThan, OrEqualTo
stream_filter = StreamFilter(Gate=larger_than.LargerThan, Stream0=" ", Stream1="Correct!")
null_item = NullItem(Item=larger_than.LargerThan)  # -> NullFlags, InvalidFlags, Description
stream_filter_2 = StreamFilter(Gate=null_item.NullFlags, Stream0=stream_filter, Stream1=" ")
data_3 = Data(stream_filter_2)
data_4 = ClusterOutput(data_3)

# ==== cluster Checker_11
data = ClusterInput()
data_2 = Data(data)
number = Number(data_2)
null_item = NullItem(Item=number)  # -> NullFlags, InvalidFlags, Description
gate_not = GateNot(A=null_item.NullFlags)
stream_filter = StreamFilter(Gate=gate_not, Stream0=" ", Stream1="Correct!")
data_3 = Data(stream_filter)
data_4 = ClusterOutput(data_3)
