# Grasshopper definition GH_Challenges_B_Logic.ghx (Grasshopper 0.9.76)

# 挑战B2: 改变滑条(slider)，筛选出大于100的数
输入数值 = Panel("""3
4
10
602
3.4
403
30
1493""")
# Grasshopper挑战
# By Dan Taeyoung, 2016. https://github.com/provolot/GrasshopperChallenges
# 马逸东 翻译，2016. https://github.com/maajor/GrasshopperChallenges
# 挑战B - 逻辑入门
# 挑战B1: 改变滑条(slider)使得两个结果都是True
number_slider = Slider(0, range=0..10)
boolean_toggle = BooleanToggle(False)
number_slider_2 = Slider(0, range=0..10)
# 挑战B7: 改变输入，让结果变为True.
boolean_toggle_2 = BooleanToggle(False)
# 挑战B8: 让结果变为True。
boolean_toggle_3 = BooleanToggle(False)
series = Series(Start=0, Step=1, Count=100)
# 挑战B4: 从上面B2挑战中复制组件，筛选出体积大于1000的球。
geometry = Geometry([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])
boolean_toggle_4 = BooleanToggle(False)
# 挑战B6: 改变布尔切换键(Boolean Toggle)，让或操作(Or)组件的结果显示为False。
boolean_toggle_5 = BooleanToggle(True)
boolean_toggle_6 = BooleanToggle(False)
# 挑战B9: 回忆一下挑战B3, 使用我们刚学的门逻辑组件来选出仅仅被7或者3整除的元素。
boolean_toggle_7 = BooleanToggle(False)
# 挑战B5: 改变布尔切换键(Boolean Toggle)，让和操作(And)组件的结果显示为True。
boolean_toggle_8 = BooleanToggle(False)
# 挑战B3: 创建一个滑条(slider)和一个等于组件(Equality)，选出所有可以被3整除的数据。
series_2 = Series(Start=0, Step=1, Count=20)
volume = Volume(Geometry=geometry)  # -> Volume, Centroid
panel = Panel(series)
panel_2 = Panel(series_2)
gate_or = GateOr(A=boolean_toggle_4, B=boolean_toggle_6)
larger_than = LargerThan(FirstNumber=输入数值, SecondNumber=Slider(1000, range=0..1000))  # -> LargerThan, OrEqualTo
gate_or_2 = GateOr(A=boolean_toggle_5, B=Toggle(True))
gate_and = GateAnd(A=boolean_toggle_6, B=boolean_toggle_7)
gate_and_2 = GateAnd(A=boolean_toggle_8, B=Toggle(False))
gate_and_3 = GateAnd(A=Toggle(False), B=boolean_toggle_4)
larger_than_2 = LargerThan(FirstNumber=number_slider, SecondNumber=number_slider_2)  # -> LargerThan, OrEqualTo
smaller_than = SmallerThan(FirstNumber=number_slider_2, SecondNumber=Slider(0, range=0..10))  # -> SmallerThan, OrEqualTo
gate_and_4 = GateAnd(A=boolean_toggle_2, B=boolean_toggle)
gate_or_3 = GateOr(A=boolean_toggle, B=boolean_toggle_3)
panel_3 = Panel(volume.Volume)
result = Panel(gate_and_2)
gate_not = GateNot(A=gate_and)
result_2 = Panel(gate_or_2)
gate_not_2 = GateNot(A=gate_and_3)

# ---- group: 模(Modulus)组件返回被整除后的余数
modulus = Modulus(A=series_2, B=Slider(3, range=0..10))

# ---- group: The 'Modulus' component calculates the remainder after division.
modulus_2 = Modulus(A=series, B=Slider(3, range=0..10))

modulus_3 = Modulus(A=series, B=Slider(7, range=0..10))

# ----
gate_not_3 = GateNot(A=gate_and_4)
panel_4 = Panel(larger_than.LargerThan)
panel_5 = Panel(smaller_than.SmallerThan)
# Double-click on the Slider on the 'Number Slider' text (or Right-click)  to edit the Slider properties.
panel_6 = Panel(larger_than_2.LargerThan)
# 提示：
checker = Checker_6(data=gate_or_2)
checker_2 = Checker_5(data=gate_and_2)
panel_7 = Panel(modulus_2)
# even/odd?
panel_8 = Panel(modulus_3)
gate_and_5 = GateAnd(A=gate_or, B=gate_not)
panel_9 = Panel(modulus)
dispatch = Dispatch(List=输入数值, DispatchPattern=larger_than.LargerThan)  # -> ListA, ListB
gate_and_6 = GateAnd(A=gate_not_3, B=gate_or_3)
panel_10 = Panel(checker)
panel_11 = Panel(checker_2)
checker_3 = Checker_4(data=larger_than_2.LargerThan, data_3=smaller_than.SmallerThan)
gate_and_7 = GateAnd(A=gate_not_2, B=gate_and_5)
# Search the menu above for 'Extrude'. Alternately, double-click on the Grasshopper canvas - this will bring up a search menu. Type 'Extrude', and choose the plain 'Extrude', not 'Extrude Along', etc..
panel_12 = Panel(checker_3)
筛选出的模式_pattern_是true的元素 = Panel(dispatch.ListA)
result_3 = Panel(gate_and_7)
筛选出的模式_pattern_是false的元素 = Panel(dispatch.ListB)
# 如果你不明白发生了什么，创建一个显示板(panel)并把它连接到输出上，看看发生了什么
result_4 = Panel(gate_and_6)
dispatch_2 = Dispatch(List=series_2, DispatchPattern=[True, False])  # -> ListA, ListB
checker_4 = Checker_5(data=gate_and_7)
checker_5 = Checker_5(data=gate_and_6)
geometry_2 = Geometry()
checker_6 = Checker(data=dispatch.ListA)
panel_13 = Panel(checker_4)
checker_7 = Checker_2(data=geometry_2)
panel_14 = Panel(checker_5)
dispatch_3 = Dispatch(List=series, DispatchPattern=[True, False])  # -> ListA, ListB
panel_15 = Panel(dispatch_2.ListA)
panel_16 = Panel(checker_6)
# 提示：
# 分派(Dispatch)组件中输入的列表(List)可以放入任意类型，不仅仅是数字。
panel_17 = Panel(checker_7)
checker_8 = Checker_3(data=dispatch_2.ListA)
panel_18 = Panel(dispatch_3.ListA)
panel_19 = Panel(checker_8)
checker_9 = Checker_7(data=dispatch_3.ListA)
panel_20 = Panel(checker_9)

# ==== cluster Checker
data = ClusterInput()
data_2 = Data(data)
list_length = ListLength(List=data_2)
equality = Equality(FirstNumber="3", SecondNumber=list_length)  # -> Equality, Inequality
stream_filter = StreamFilter(Gate=equality.Equality, Stream0=" ", Stream1="Correct!")
null_item = NullItem(Item=equality.Equality)  # -> NullFlags, InvalidFlags, Description
stream_filter_2 = StreamFilter(Gate=null_item.NullFlags, Stream0=stream_filter, Stream1=" ")
data_3 = Data(stream_filter_2)
data_4 = ClusterOutput(data_3)

# ==== cluster Checker_2
data = ClusterInput()
data_2 = Data(data)
geometry = Geometry(data_2)
volume = Volume(Geometry=geometry)  # -> Volume, Centroid
mass_addition = MassAddition(Input=volume.Volume)  # -> Result, PartialResults
similarity = Similarity(FirstNumber=mass_addition.Result, SecondNumber="16737", Threshold=0.1)  # -> Similarity, AbsoluteDifference
equality = Equality(FirstNumber="5")  # -> Equality, Inequality
stream_filter = StreamFilter(Gate=similarity.Similarity, Stream0=" ", Stream1="Correct!")
null_item = NullItem(Item=similarity.Similarity)  # -> NullFlags, InvalidFlags, Description
stream_filter_2 = StreamFilter(Gate=null_item.NullFlags, Stream0=stream_filter, Stream1=" ")
data_3 = Data(stream_filter_2)
data_4 = ClusterOutput(data_3)

# ==== cluster Checker_3
data = ClusterInput()
data_2 = Data(data)
mass_addition = MassAddition(Input=data_2)  # -> Result, PartialResults
equality = Equality(FirstNumber="63", SecondNumber=mass_addition.Result)  # -> Equality, Inequality
stream_filter = StreamFilter(Gate=equality.Equality, Stream0=" ", Stream1="Correct!")
null_item = NullItem(Item=equality.Equality)  # -> NullFlags, InvalidFlags, Description
stream_filter_2 = StreamFilter(Gate=null_item.NullFlags, Stream0=stream_filter, Stream1=" ")
data_3 = Data(stream_filter_2)
data_4 = ClusterOutput(data_3)

# ==== cluster Checker_4
data = ClusterInput()
data_2 = Data(data)
data_3 = ClusterInput()
list_length = ListLength(List=data_2)
data_4 = Data(data_3)
gate_and = GateAnd(A=data_2, B=data_4)
equality = Equality(FirstNumber="3", SecondNumber=list_length)  # -> Equality, Inequality
stream_filter = StreamFilter(Gate=gate_and, Stream0=" ", Stream1="Correct!")
null_item = NullItem(Item=gate_and)  # -> NullFlags, InvalidFlags, Description
stream_filter_2 = StreamFilter(Gate=null_item.NullFlags, Stream0=stream_filter, Stream1=" ")
data_5 = Data(stream_filter_2)
data_6 = ClusterOutput(data_5)

# ==== cluster Checker_5
data = ClusterInput()
data_2 = Data(data)
stream_filter = StreamFilter(Gate=data_2, Stream0=" ", Stream1="Correct!")
data_3 = Data(stream_filter)
data_4 = ClusterOutput(data_3)

# ==== cluster Checker_6
data = ClusterInput()
data_2 = Data(data)
gate_not = GateNot(A=data_2)
stream_filter = StreamFilter(Gate=gate_not, Stream0=" ", Stream1="Correct!")
data_3 = Data(stream_filter)
data_4 = ClusterOutput(data_3)

# ==== cluster Checker_7
data = ClusterInput()
data_2 = Data(data)
mass_addition = MassAddition(Input=data_2)  # -> Result, PartialResults
equality = Equality(FirstNumber="2208", SecondNumber=mass_addition.Result)  # -> Equality, Inequality
stream_filter = StreamFilter(Gate=equality.Equality, Stream0=" ", Stream1="Correct!")
null_item = NullItem(Item=equality.Equality)  # -> NullFlags, InvalidFlags, Description
stream_filter_2 = StreamFilter(Gate=null_item.NullFlags, Stream0=stream_filter, Stream1=" ")
data_3 = Data(stream_filter_2)
data_4 = ClusterOutput(data_3)
