# Grasshopper definition GH_Challenges_C_Lists.ghx (Grasshopper 0.9.76)

point = Point(Point(200, 40, 0))
# 挑战C3: 添加一个线段(Line)组件，在两点中创建一条线。
point_2 = Point(Point(180, 39.22960831, 0))
# Grasshopper挑战
# By Dan Taeyoung, 2016. https://github.com/provolot/GrasshopperChallenges
# 马逸东 翻译，2016. https://github.com/maajor/GrasshopperChallenges
# 挑战C - 熟悉列表(List)和树(Tree)数据
# 挑战C1: 添加一个数列(Series)组件，创建10个点，沿Y方向递增分布。
construct_point = ConstructPoint(XCoordinate=0, YCoordinate=0, ZCoordinate=0)
point_3 = Point([Point(264.7599814, 80, 0), Point(264.7599814, 60, 0), Point(264.7599814, 40, 0), Point(264.7599814, 20, 0), Point(264.7599814, 0, 0)])
# 挑战C3: 添加一个线段(Line)组件，让一个点和另外列表中五个点分别相连。
point_4 = Point(Point(244.7599814, 31.74540076, 0))
point_5 = Point([Point(328.4024885, 80, 0), Point(328.4024885, 60, 0), Point(328.4024885, 40, 0), Point(328.4024885, 20, 0), Point(328.4024885, 0, 0)])
# 挑战C4: 添加一个线段(Line)组件和一个种树(Graft)组，创建出四个点和另外五个点分别为始终点的所有可能的线。
point_6 = Point([Point(308.4024885, 70, 0), Point(308.4024885, 50, 0), Point(308.4024885, 30, 0), Point(308.4024885, 10, 0)])

geometry = Geometry(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)
# 挑战C6: 使用C5中的答案，把残圆图案移动到每一个格点上，然后用一个滑条(slider)来控制旋转(Rotate)组件，在格点上一起旋转它们，
point_7 = Point(Point(464.2548871, -34.81808073, 0))

# ----
# 挑战C7: 改变现有的电池组，产生从0到2 * Pi (6.2831)区间中的10个随机数。
geometry_2 = Geometry([Point(495.0365926, 62.30719088, 0), Point(489.0365926, 62.30719088, 0), Point(483.0365926, 62.30719088, 0), Point(477.0365926, 62.30719088, 0), Point(471.0365926, 62.30719088, 0), Point(495.0365926, 56.30719088, 0)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])
series = Series(Start=0, Step=Slider(20, range=0..100), Count=Slider(5, range=0..10))

geometry_3 = Geometry(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)
# 挑战C5: 连接移动(Move)组件，把六边形移动到每个点上。
point_8 = Point(Point(393.2537864, 20.9515941, 0))

point_9 = Point([Point(391.7312824, 55.20557001, 0), Point(391.8084777, 56.93451418, 0), Point(392.9786943, 43.72579915, 0), Point(396.7889657, 41.48964297, 0), Point(395.8451172, 48.32924102, 0), Point(389.1970222, 43.45966327, 0), Point(402.3091418, 49.45130599, 0), Point(395.8346161, 59.10035069, 0)])
# 挑战C2: 连接种树(Graft)组件，并创建5x5格点的点。
geometry_4 = Geometry([Point(50, 0, 0), Point(50, 20, 0), Point(50, 40, 0), Point(50, 60, 0), Point(50, 80, 0)])
unit_y = UnitY(Factor=1)
# 挑战C8: 合并挑战C6和挑战C7，创建一个格点的点。在每个格点上，放置一个你画的多段线，然后对每个格点上的物体随机旋转任意角度。
panel = Panel("和本例结果比较：")
# 额外挑战E-C1: 创建一组点，让他们看上去像三角形。从一个点开始，然后两个点，三个点...使用数列(Series)组件。
panel_2 = Panel("和本例结果比较：")
# 额外挑战E-C2: 创建一组像金字塔的点，使用下面的组件。
panel_3 = Panel("和本例结果比较：")
number_slider = Slider(1, range=0..1)
construct_domain = ConstructDomain(DomainStart=Slider(0, range=0..6.283), DomainEnd=Slider(10, range=0..10))
unit_x = UnitX(Factor=series)

# ---- group: 这个种子(Seed)可以是任意一个数，它用来改变随机数组件(Random)的伪随机度。随机数发生器实际上产生的都是伪随机数，就是说如果种子(Seed)一样的话，每次产生一样的随机数。
number_slider_2 = Slider(6319, range=0..10000)

# ----
example_result = Geometry([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])
example_result_2 = Geometry([Point(660, 96.37552148, 0), Point(670, 96.37552148, 0), Point(680, 96.37552148, 0), Point(690, 96.37552148, 0), Point(700, 96.37552148, 0), Point(660, 96.37552148, 0), Point(670, 106.3755215, 0), Point(680, 106.3755215, 0), Point(690, 106.3755215, 0), Point(700, 106.3755215, 0), Point(660, 96.37552148, 0), Point(670, 106.3755215, 0), Point(680, 116.3755215, 0), Point(690, 116.3755215, 0), Point(700, 116.3755215, 0), Point(660, 96.37552148, 0), Point(670, 106.3755215, 0), Point(680, 116.3755215, 0), Point(690, 126.3755215, 0), Point(700, 126.3755215, 0), Point(660, 96.37552148, 0), Point(670, 106.3755215, 0), Point(680, 116.3755215, 0), Point(690, 126.3755215, 0), Point(700, 136.3755215, 0)])
example_result_3 = Geometry([Point(807.3078012, 136.3755215, 0), Point(797.3078012, 126.3755215, 0), Point(787.3078012, 116.3755215, 0), Point(777.3078012, 106.3755215, 0), Point(767.3078012, 96.37552148, 0), Point(807.3078012, 126.3755215, 0)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])

# ---- group: 在Grasshopper里，移动(Move)基本上相当于复制，它移动原有的物体，并创建一个新的
move = Move(Geometry=construct_point, Motion=unit_y)  # -> Geometry, Transform

# ----
vector_2pt = Vector2Pt(PointA=point_8, PointB=point_9, Unitize=False)  # -> Vector, Length
vector_2pt_2 = Vector2Pt(PointA=point_7, PointB=geometry_2, Unitize=False)  # -> Vector, Length
geometry_5 = Geometry()
geometry_6 = Geometry()
series_2 = Series(Start=number_slider, Step=1, Count=Slider(10, range=0..10))  # -> graft(Series)
geometry_7 = Geometry()
random = Random(Range=construct_domain, Number=1, Seed=number_slider_2)

# ---- group: 找个地方放它，我们后面会解释
graft_tree = GraftTree(IncludeEmptyLists=True, IncludeNullItems=True)

# ----
checker = Checker_6(data=geometry_5)
checker_2 = Checker_4(data=geometry_6)
checker_3 = Checker_5(data=geometry_7)

# ---- group: 这个组件帮你可视化向量
vector_display = VectorDisplay(Anchor=point_8, Vector=vector_2pt.Vector)

# ----
panel_4 = Panel(checker)
panel_5 = Panel(checker_2)
series_3 = Series(Start=number_slider, Step=1, Count=10)

# ---- group: 在Grasshopper里，移动(Move)基本上相当于复制，它移动原有的物体，并创建一个新的
move_2 = Move(Geometry=geometry_4, Motion=unit_x)  # -> Geometry, Transform

# ----
panel_6 = Panel(random)
panel_7 = Panel(checker_3)

# ---- group: 这个组件可视化了树的结构。当你种树(Grapft)时，你把你的列表中每个元素变成了一个列表，每个列表一个元素。比如本来有10个元素，就会变成10个列表每个列表一个元素。
param_viewer = ParamViewer(geometry_7)

# ---- group: 每一个灰条或者说标题，区分了每个新的列表(List)，或者称为枝杈(Branch)。在一个列表的列表中(也就是树)，每一个单独的列表都是一个枝杈(Branch)
panel_8 = Panel(geometry_7)

# ----
move_3 = Move(Motion=Vector(0, 0, 10))  # -> Geometry, Transform
checker_4 = Checker(data=move.Geometry)
series_4 = Series(Start=number_slider, Step=1, Count=10)
# 提示：
# 有两个长的很像的线段(Line)组件。一个存储线段，另一个生成线段。你需要的是后一个。
checker_5 = Checker_3(data=move_2.Geometry)
# Double-click on the Slider on the 'Number Slider' text (or Right-click)  to edit the Slider properties.
# Search the menu above for 'Extrude'. Alternately, double-click on the Grasshopper canvas - this will bring up a search menu. Type 'Extrude', and choose the plain 'Extrude', not 'Extrude Along', etc..
panel_9 = Panel(checker_4)
geometry_8 = Geometry(move_3.Geometry)
graft_tree_2 = GraftTree(IncludeEmptyLists=True, IncludeNullItems=True)
panel_10 = Panel(checker_5)
checker_6 = Checker_2(data=geometry_8)
rotate = Rotate(Angle=Slider(3.055, range=0..6.283), Plane=PlaneXY(0, 0, 0))  # -> Geometry, Transform
unit_z = UnitZ(Factor=1)
construct_point_2 = ConstructPoint(XCoordinate=graft_tree_2, YCoordinate=0, ZCoordinate=0)  # -> simplify(Point)
panel_11 = Panel(checker_6)
# 'List Item' is able to get a letter, given what inputs?
# If only that was more random...
trim_tree = TrimTree(Tree=construct_point_2, Depth=1)
move_4 = Move(Geometry=trim_tree, Motion=unit_z)  # -> Geometry, Transform
panel_12 = Panel("和本例结果比较：")
# 提示：
# 如果旋转非常奇怪，那是因为旋转(Rotate)组件需要一个旋转中心——平面(Plane)输入。从哪里可以得到几何体旋转中心的那些点呢？
example_result_4 = Geometry([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])
# 提示：
# 每个元素都是数列的数列
custom_preview = CustomPreview(Geometry=rotate.Geometry, Shader=ColourSwatch(SwatchColor=RGB(247, 33, 255)))

# ==== cluster Checker
data = ClusterInput()
data_2 = Data(data)
list_length = ListLength(List=data_2)
equality = Equality(FirstNumber="10", SecondNumber=list_length)  # -> Equality, Inequality
stream_filter = StreamFilter(Gate=equality.Equality, Stream0=" ", Stream1="Correct!")
null_item = NullItem(Item=equality.Equality)  # -> NullFlags, InvalidFlags, Description
stream_filter_2 = StreamFilter(Gate=null_item.NullFlags, Stream0=stream_filter, Stream1=" ")
data_3 = Data(stream_filter_2)
data_4 = ClusterOutput(data_3)

# ==== cluster Checker_2
data = ClusterInput()
data_2 = Data(data)
curve = Curve(data_2)
clean_tree = CleanTree(RemoveNulls=True, RemoveInvalid=True, RemoveEmpty=False, Tree=curve)
list_length = ListLength(List=flatten(clean_tree))
larger_than = LargerThan(SecondNumber=0)  # -> LargerThan, OrEqualTo
equality = Equality(FirstNumber="8", SecondNumber=list_length)  # -> Equality, Inequality
stream_filter = StreamFilter(Gate=equality.Equality, Stream0=" ", Stream1="Correct!")
null_item = NullItem(Item=equality.Equality)  # -> NullFlags, InvalidFlags, Description
stream_filter_2 = StreamFilter(Gate=null_item.NullFlags, Stream0=stream_filter, Stream1=" ")
data_3 = Data(stream_filter_2)
data_4 = ClusterOutput(data_3)

# ==== cluster Checker_3
data = ClusterInput()
data_2 = Data(data)
tree_statistics = TreeStatistics(Tree=data_2)  # -> Paths, Length, Count
equality = Equality(FirstNumber="5", SecondNumber=tree_statistics.Count)  # -> Equality, Inequality
stream_filter = StreamFilter(Gate=equality.Equality, Stream0=" ", Stream1="Correct!")
null_item = NullItem(Item=equality.Equality)  # -> NullFlags, InvalidFlags, Description
stream_filter_2 = StreamFilter(Gate=null_item.NullFlags, Stream0=stream_filter, Stream1=" ")
data_3 = Data(stream_filter_2)
data_4 = ClusterOutput(data_3)

# ==== cluster Checker_4
data = ClusterInput()
data_2 = Data(data)
length = Length(Curve=data_2)
tree_statistics = TreeStatistics(Tree=data_2)  # -> Paths, Length, Count
mass_addition = MassAddition(Input=length)  # -> Result, PartialResults
larger_than = LargerThan(FirstNumber=mass_addition.Result, SecondNumber=0)  # -> LargerThan, OrEqualTo
equality = Equality(FirstNumber="5", SecondNumber=tree_statistics.Count)  # -> Equality, Inequality
stream_filter = StreamFilter(Gate=larger_than.LargerThan, Stream0=" ", Stream1="Correct!")
null_item = NullItem(Item=larger_than.LargerThan)  # -> NullFlags, InvalidFlags, Description
stream_filter_2 = StreamFilter(Gate=null_item.NullFlags, Stream0=stream_filter, Stream1=" ")
data_3 = Data(stream_filter_2)
data_4 = ClusterOutput(data_3)

# ==== cluster Checker_5
data = ClusterInput()
data_2 = Data(data)
list_length = ListLength(List=flatten(data_2))
larger_than = LargerThan(SecondNumber=0)  # -> LargerThan, OrEqualTo
equality = Equality(FirstNumber="20", SecondNumber=list_length)  # -> Equality, Inequality
stream_filter = StreamFilter(Gate=equality.Equality, Stream0=" ", Stream1="Correct!")
null_item = NullItem(Item=equality.Equality)  # -> NullFlags, InvalidFlags, Description
stream_filter_2 = StreamFilter(Gate=null_item.NullFlags, Stream0=stream_filter, Stream1=" ")
data_3 = Data(stream_filter_2)
data_4 = ClusterOutput(data_3)

# ==== cluster Checker_6
data = ClusterInput()
data_2 = Data(data)
tree_statistics = TreeStatistics(Tree=data_2)  # -> Paths, Length, Count
length = Length(Curve=data_2)
larger_than = LargerThan(FirstNumber=length, SecondNumber=Slider(0.01, range=0..0.01))  # -> LargerThan, OrEqualTo
equality = Equality(FirstNumber="5", SecondNumber=tree_statistics.Count)  # -> Equality, Inequality
stream_filter = StreamFilter(Gate=larger_than.LargerThan, Stream0=" ", Stream1="Correct!")
null_item = NullItem(Item=larger_than.LargerThan)  # -> NullFlags, InvalidFlags, Description
stream_filter_2 = StreamFilter(Gate=null_item.NullFlags, Stream0=stream_filter, Stream1=" ")
data_3 = Data(stream_filter_2)
data_4 = ClusterOutput(data_3)
